vi "index.gviweb"   [G Web Development Software 21.0.0]
panel indicators:
  "#bakedPizzas": f64
uses:
  NI::Skyline::Configuration::Open Configuration API Key.gvi
  NI::Skyline::TagHTTP::Open Tag.gvi
  NI::Skyline::TagHTTP::Read Tag (DBL).gvi
diagram:
  call "Open Configuration API Key.gvi"(server url="https://api.systemlinkcloud.com", api key="zuZocpsIT5eClugZo8Gr3c5huu4OT5rWAaLG5srNxA") -> (configuration=w1)
  call "Open Tag.gvi"(path="CMES_A3b", data type="U64", configuration=w1) -> (tag=w2)
  # Place setup code before the loop. For example, perform initial data communication and wire the results into the loop.
  # Top-Level WebVIs usually contain a While Loop that never stops so that they can continue running as long as the web page is open in the user's web browser.
  while {
    call "Read Tag (DBL).gvi"(tag in=w2) -> (value=w3)
    $"#bakedPizzas" <- w3
    Wait(time to wait=50)
    stop if FALSE
  }
